# Grasshopper definition Clippty.gh (Grasshopper 1.0.7)

slot_width = Slider(2.4, range=0..10)
radius = Slider(11, range=0..20)
slot_depth = Slider(15, range=0..15)
y_distance = Slider(4.853, range=0..10)
division = Division(A=slot_width, B=-2)
rectangle = Rectangle(Plane=PlaneXY(0, 0, 0), XSize=slot_width, YSize=radius, Radius=0)  # -> Rectangle, Length
vector_xyz = VectorXYZ(XComponent=division, YComponent=y_distance, ZComponent=0)  # -> Vector, Length
circle = Circle(Plane=PlaneXY(0, 0, 0), Radius=radius)
move = Move(Geometry=rectangle.Rectangle, Motion=vector_xyz.Vector)  # -> Geometry, Transform
number_of_slots = Slider(4, range=0..10)
polar_array = PolarArray(Geometry=move.Geometry, Plane=PlaneXY(0, 0, 0), Count=number_of_slots, Angle=6.283185307)  # -> Geometry, Transform
group = Group(Objects=[circle, polar_array.Geometry])
