# Grasshopper definition nested geometry.gh (Grasshopper 1.0.7)

radius = Slider(6, range=0..15)
sides = Slider(6, range=0..10)
offset = Slider(3.075, range=0..15)
polygon = Polygon(Plane=PlaneXY(0, 0, 0), Radius=radius, Segments=sides, FilletRadius=0)  # -> Polygon, Length
offset_curve = OffsetCurve(Curve=polygon.Polygon, Distance=offset, Plane=PlaneXY(0, 0, 0), Corners=1)
offset_curve_2 = OffsetCurve(Curve=offset_curve, Distance=offset, Plane=PlaneXY(0, 0, 0), Corners=1)
offset_curve_3 = OffsetCurve(Curve=offset_curve_2, Distance=offset, Plane=PlaneXY(0, 0, 0), Corners=1)
offset_curve_4 = OffsetCurve(Curve=offset_curve_3, Distance=offset, Plane=PlaneXY(0, 0, 0), Corners=1)
offset_curve_5 = OffsetCurve(Curve=offset_curve_4, Distance=offset, Plane=PlaneXY(0, 0, 0), Corners=1)
offset_curve_6 = OffsetCurve(Curve=offset_curve_5, Distance=offset, Plane=PlaneXY(0, 0, 0), Corners=1)
offset_curve_7 = OffsetCurve(Curve=offset_curve_6, Distance=offset, Plane=PlaneXY(0, 0, 0), Corners=1)
group = Group(Objects=[offset_curve_7, offset_curve_6, offset_curve_5, offset_curve_4, offset_curve_3, offset_curve_2, offset_curve, polygon.Polygon])
